# Dynamo graph script.dyn (Dynamo 2.16.2.5624)
# packages: archi-lab.net 2024.217.1024, Data-Shapes 2025.3.118

code_block = CodeBlock { "SpecSheet Place"; "Place Them!"; }
code_block_2 = CodeBlock { "Pick File"; }
code_block_3 = CodeBlock { "Select your PDF"; }
filepath_data = Custom[FilePath Data](InputName=code_block_2, ButtonText=code_block_3)  # package Data-Shapes; Create filepath input for UI.MultipleInputForm ++ . Check out www.data-shapes.net for more infos !
titleblock_names = Python()  # CPython3; graph input
# ---------- titleblock_names.python (20 lines) ----------
# this script uses dynamobim inside revit
# using python 3.x with dynamo 3.0

# this script uses dynamobim inside revit
# using python 3.x with dynamo 3.0

import clr
clr.AddReference('RevitAPI')
clr.AddReference('RevitServices')
from Autodesk.Revit.DB import *
from RevitServices.Persistence import DocumentManager

# get the list of titleblocks
doc = DocumentManager.Instance.CurrentDBDocument
collector = FilteredElementCollector(doc)
titleblocks = collector.OfClass(FamilySymbol).OfCategory(BuiltInCategory.OST_TitleBlocks).ToElements()
titleblocknames = [tb.Family.Name for tb in titleblocks]


OUT = titleblocknames
# ----------------------------------------
titleblocks = Python()  # CPython3; graph input
# ---------- titleblocks.python (20 lines) ----------
# this script uses dynamobim inside revit
# using python 3.x with dynamo 3.0

# this script uses dynamobim inside revit
# using python 3.x with dynamo 3.0

import clr
clr.AddReference('RevitAPI')
clr.AddReference('RevitServices')
from Autodesk.Revit.DB import *
from RevitServices.Persistence import DocumentManager

# get the list of titleblocks
doc = DocumentManager.Instance.CurrentDBDocument
collector = FilteredElementCollector(doc)
titleblocks = collector.OfClass(FamilySymbol).OfCategory(BuiltInCategory.OST_TitleBlocks).ToElements()
titleblocknames = [tb.Family.Name for tb in titleblocks]

OUT = titleblocks
OUT2 = titleblocknames
# ----------------------------------------
boolean = BoolSelector(false)
dropdown_data = Custom[DropDown Data](Keys=titleblock_names, Values=titleblocks, Sorted_optional=boolean)  # package Data-Shapes; Create data for DropDown input in UI.MultiInputForm ++ . Check out www.data-shapes.net for more infos.
list_create = List.Create(item0=filepath_data, item1=dropdown_data)
boolean_2 = BoolSelector(true)
multipleinputform = Custom[MultipleInputForm ++](Description_optional=code_block.out0, Logo_optional=code_block.out0, ButtonText_optional=code_block.out1, Inputs=list_create, Toggle=boolean_2)  # package Data-Shapes; Create a form with multiple inputs. see www.data-shapes.net for tutorials and infos!
firstItem = List.FirstItem(list=multipleinputform.User_Inputs)
pageCount = archilab.Pdf.PDF.PageCount(filePath=firstItem)
spec_pages_count = Watch(pageCount)
code_block_4 = CodeBlock { "SPECIFICATIONS SHEET"; }
code_block_5 = CodeBlock { "A9."; }
code_block_6 = CodeBlock { 1; }
code_block_7 = CodeBlock(x=pageCount) { 150; 1..x; }
create = archilab.Revit.Elements.ImageTypeOptions.Create(filePath=firstItem, resolution=code_block_7.out0, pageNumber=code_block_7.out1)
boolean_3 = BoolSelector(true)
create_2 = archilab.Revit.Elements.ImageTypes.Create(imageTypeOptions=create, reload=boolean_3)
count = List.Count(list=create_2)

# group: Placement Point
code_block_8 = CodeBlock { 0.6; 2; 0; }
byCoordinates = Point.ByCoordinates(x=code_block_8.out0, y=code_block_8.out1, z=code_block_8.out2)
code_block_9 = CodeBlock { 1.31; 2; 0; }
byCoordinates_2 = Point.ByCoordinates(x=code_block_9.out0, y=code_block_9.out1, z=code_block_9.out2)
code_block_10 = CodeBlock { 2.03; 2; 0; }
byCoordinates_3 = Point.ByCoordinates(x=code_block_10.out0, y=code_block_10.out1, z=code_block_10.out2)
code_block_11 = CodeBlock { 2.74; 2; 0; }
byCoordinates_4 = Point.ByCoordinates(x=code_block_11.out0, y=code_block_11.out1, z=code_block_11.out2)
code_block_12 = CodeBlock { 0.6; 1.25; 0; }
byCoordinates_5 = Point.ByCoordinates(x=code_block_12.out0, y=code_block_12.out1, z=code_block_12.out2)
code_block_13 = CodeBlock { 1.31; 1.25; 0; }
byCoordinates_6 = Point.ByCoordinates(x=code_block_13.out0, y=code_block_13.out1, z=code_block_13.out2)
code_block_14 = CodeBlock { 2.03; 1.25; 0; }
byCoordinates_7 = Point.ByCoordinates(x=code_block_14.out0, y=code_block_14.out1, z=code_block_14.out2)
code_block_15 = CodeBlock { 2.74; 1.25; 0; }
byCoordinates_8 = Point.ByCoordinates(x=code_block_15.out0, y=code_block_15.out1, z=code_block_15.out2)
code_block_16 = CodeBlock { 0.6; 0.5; 0; }
byCoordinates_9 = Point.ByCoordinates(x=code_block_16.out0, y=code_block_16.out1, z=code_block_16.out2)
code_block_17 = CodeBlock { 1.31; 0.5; 0; }
byCoordinates_10 = Point.ByCoordinates(x=code_block_17.out0, y=code_block_17.out1, z=code_block_17.out2)
code_block_18 = CodeBlock { 2.03; 0.5; 0; }
byCoordinates_11 = Point.ByCoordinates(x=code_block_18.out0, y=code_block_18.out1, z=code_block_18.out2)
code_block_19 = CodeBlock { 2.74; 0.5; 0; }
byCoordinates_12 = Point.ByCoordinates(x=code_block_19.out0, y=code_block_19.out1, z=code_block_19.out2)
list_create_2 = List.Create(item0=byCoordinates, item1=byCoordinates_2, item2=byCoordinates_3, item3=byCoordinates_4, item4=byCoordinates_5, item5=byCoordinates_6, item6=byCoordinates_7, item7=byCoordinates_8, item8=byCoordinates_9, item9=byCoordinates_10, item10=byCoordinates_11, item11=byCoordinates_12)

count_2 = List.Count(list=list_create_2)
div = count / count_2
ceiling = Math.Ceiling(number=div)
range = Range(start=code_block_6, end=ceiling, step=code_block_6)
python_script = Python(IN[0]=range)  # CPython3
# ---------- python_script.python (28 lines) ----------
# Load the Python Standard and DesignScript Libraries


# The inputs to this node will be stored as a list in the IN variables.
dataEnteringNode = IN[0]

# Defunction for converting a positive integer to a two-digit string
def convert_to_two_digit_string(number):
    """
    Converts a positive integer to a two-digit string.
    :param number: Positive integer
    :return: Two-digit string
    """
    if isinstance(number, int) and number >= 0:
        return f"{number:02}"  # Format the number with leading zero if needed
    else:
        return "Invalid input. Please enter a non-negative integer."

# Convert the input to a two-digit string
#enumirate througth the list of input and convert each element to a two digit string
result = []
for item in dataEnteringNode:
    try:
        user_number = int(item)
        result.append(convert_to_two_digit_string(user_number))
    except ValueError:
        result.append("Invalid input. Please enter a valid integer.")
OUT = result
# ----------------------------------------
string_from_object = FromObject(object=python_script)
add = code_block_5 + string_from_object
lastItem = List.LastItem(list=multipleinputform.User_Inputs)
byNameNumberTitleBlock = Sheet.ByNameNumberTitleBlock(sheetName=code_block_4, sheetNumber=add, titleBlockFamilyType=lastItem)

# group: Sort Sheets on the Project Browser
code_block_20 = CodeBlock { "BA Sheet Discipline"; "BA Sheet Division"; }
parameterByName = Parameter.ParameterByName(element=byNameNumberTitleBlock, name=code_block_20.out0)
code_block_21 = CodeBlock { "5 - ARCHITECTURAL"; "A9.0 Specifications"; }
setValue = Parameter.SetValue(parameter=parameterByName, value=code_block_21.out0)
parameterByName_2 = Parameter.ParameterByName(element=byNameNumberTitleBlock, name=code_block_20.out1)
setValue_2 = Parameter.SetValue(parameter=parameterByName_2, value=code_block_21.out1)

watch = Watch(python_script)
chop = List.Chop(list=create_2, lengths=count_2)
list_create_3 = List.Create(item0=list_create_2)

# group: DEFINE PLACEMENT
box_placement_types = BoxPlacementTypeUi("Center")
create_3 = archilab.Revit.Elements.ImagePlacementOptions.Create(location=list_create_3, boxPlacementType=box_placement_types)

# group: Scale Down the Pages
create_4 = archilab.Revit.Elements.ImageInstances.Create(view=byNameNumberTitleBlock, imageType=chop, imagePlacementOptions=create_3, lacing=Longest)
code_block_22 = CodeBlock { "Horizontal Scale"; "Vertical Scale"; }
parameterByName_3 = Parameter.ParameterByName(element=create_4, name=code_block_22.out0)
number_slider = DoubleSlider(0.8, range=0.1..2 step 0.1)
setValue_3 = Parameter.SetValue(parameter=parameterByName_3, value=number_slider)
parameterByName_4 = Parameter.ParameterByName(element=create_4, name=code_block_22.out1)
setValue_4 = Parameter.SetValue(parameter=parameterByName_4, value=number_slider)
